# Grasshopper definition 02_EdgeConstraints.gh (Grasshopper 1.0.7)
# plug-ins: g3gh Info, Human, Sketch

number_slider = Slider(1, range=0..1)
brep = Brep(<brep referenced from the Rhino model>)
custom_mesh_settings = SettingsCustom(
    StitchSeams=True,
    SimplePlanes=False,
    Refine=True,
    MinCount=16,
    MaxCount=400,
    AspectRatio=20,
    MaxDistance=0,
    MaxAngle=20,
    MinEdge=number_slider,
    MaxEdge=number_slider)
mesh = MeshBrep(Brep=brep, Settings=custom_mesh_settings)
tri = Triangulate(Mesh=mesh)  # -> Mesh, Count
medges = MeshEdges(Mesh=tri.Mesh)  # -> NakedEdges, InteriorEdges, NonManifoldEdges
preview = CustomPreview(Geometry=mesh, Material=ColourSwatch(SwatchColor=RGB(255, 255, 255)))
dm3 = DMesh3(tri.Mesh)
repairmsh = RepairMesh(Mesh=dm3)
debrep = DeconstructBrep(Brep=brep)  # -> Faces, Edges, Vertices
nickname = MeshCreaseEdgeLoops(DMesh3=repairmsh, CreaseAngle=Slider(24, range=0..90))  # -> CreaseEdgeSpans, CreaseEdgeLoops
crv = Curve(debrep.Edges)
nickname_2 = EdgeConstraintType(AllowFlip=Toggle(False), AllowCollapse=Toggle(True), AllowSplit=Toggle(True), PreserveTopology=Toggle(False))
crv_2 = Curve(nickname.CreaseEdgeSpans)
espan = EdgeSpan(nickname.CreaseEdgeSpans)
eloop = EdgeLoop(nickname.CreaseEdgeLoops)
previewlw = CustomPreviewLineweights(Geometry=crv_2, Shader=ColourSwatch(SwatchColor=RGB(255, 0, 0)), Thickness=Slider(3, range=0..10), Absolute=False)
nickname_3 = CreateEdgeConstraintSpan(EdgeSpan=espan, EdgeConstraintType=nickname_2, PinEdgePoints=Toggle(False))
nickname_4 = CreateEdgeConstraintLoop(EdgeLoop=eloop, EdgeConstraintType=nickname_2, PinEdgePoints=Toggle(False))
nickname_5 = RemeshZombie(
    Mesh=repairmsh,
    TargetEdgeLength=Slider(1, range=0..1),
    PointConstraints=debrep.Vertices,
    ConstrainBoundaries=0,
    CustomEdgeConstraints=nickname_3,
    ProjectToInput=True,
    NumberOfIterations=10,
    SmoothingSpeed=Slider(0.7, range=0..1))
meshsdf = NewMeshSDF(MeshToMap=nickname_5, NumberOfCells=Slider(64, range=0..100))
isosrf = MarchingCubesIsoSurface(Grid=meshsdf, Value=0, Expansion=0, Modes=1, steps=5)
mesh_2 = Mesh(nickname_5)
medges_2 = MeshEdges(Mesh=mesh_2)  # -> NakedEdges, InteriorEdges, NonManifoldEdges
previewlw_2 = CustomPreviewLineweights(Geometry=[medges_2.NakedEdges, medges_2.InteriorEdges], Shader=ColourSwatch(SwatchColor=RGB(0, 0, 0)), Absolute=False)
meshoutline = DrawMeshOutline(Mesh=mesh_2, Colour=ColourSwatch(SwatchColor=RGB(0, 0, 0)), Thickness=Slider(5, range=0..10))
