# Grasshopper definition example_file.gh (Grasshopper 1.0.7)
# plug-ins: g3gh Info

# ---- group: Read Mesh from file
getfolder = GetCurrentFolder()  # -> path
# ---------- getfolder: Python ----------
__author__ = "joelhilmersson"

import rhinoscriptsyntax as rs

import os


if(ghdoc.Path):
    path = os.path.dirname(ghdoc.Path)
# ---------- end getfolder ----------
concat = Concatenate(FragmentA=getfolder, FragmentB="stanfordbunny.obj", JoinSeparator="/")
dmshfromobj = ReadFromFile(FilePath=concat)

# ----
nickname = NewGrid3f(Origin=Point(0, 0, 0), XCells=16, YCells=16, ZCells=16, CellSize=1)

bbox = BoundingBox(Content=nickname, Plane=PlaneXY(0, 0, 0))  # -> Box, Box_2
pop3d = Populate3D(Region=bbox.Box, Count=5, Seed=8)

# ---- group: Mesh
dm3 = DMesh3(dmshfromobj)

# ---- group: Simple matching cubes example
grid3f = Grid3f(nickname)  # disabled
pt = Point(pop3d)

# ---- group: Implicit Boolean Intersection
number_slider = Slider(86, range=0..100)
number_slider_2 = Slider(90, range=0..100)
dm3_2 = DMesh3(dm3)  # disabled

# ----
dm3_3 = DMesh3(dm3)  # disabled
number_slider_3 = Slider(10, range=0..10)

# ---- group: Fill all holes iteratively
dm3_4 = DMesh3(dm3)  # disabled
iterholefill = IterativeMeshHoleFill(DMesh3=dm3_4, EdgeLength=1, Type=1)

# ---- group: Simple matching cubes example
ptdist = PointDistanceField(Grid=grid3f, Points=pt)
isosrf = MarchingCubesIsoSurface(Grid=ptdist, Value=Slider(7, range=0..10), Expansion=0, Modes=1, steps=5)

# ----
edgestats = MeshEdgeStatistics(Mesh=dm3_3)  # -> MaxEdgeLength, MinEdgeLength, AverageEdgeLength
multiplication = Multiplication(A=edgestats.AverageEdgeLength, B=Slider(2, range=0..10))

# ---- group: Reduce Mesh
toggle = BooleanToggle(False)
toggle_2 = BooleanToggle(False)

# ---- group: Implicit Boolean Intersection
rotdmesh3 = Rotate(Mesh=dm3_2, RotationAngle=number_slider_2, Plane=PlaneXY(0, 0, 0))
implinters = ImplicitIntersection(Meshes=rotdmesh3, NumberOfCells=number_slider)

# ---- group: Zombie Remesh
nickname_2 = RemeshZombie(
    Mesh=dm3_3,
    TargetEdgeLength=multiplication,
    NumberOfIterations=number_slider_3,
    ConstrainEdges=False,
    ProjectToInput=False)

# ---- group: Right click to set time step
rmsh = Remesh(
    Mesh=dm3_3,
    TargetEdgeLength=multiplication,
    NumberOfIterations=number_slider_3,
    ConstrainEdges=True,
    ProjectToInput=True,
    Run=Toggle(True),
    Reset=Button())

# ---- group: Simple matching cubes example / Marching cubes meshes sometimes need repairing
repairmsh = RepairMesh(Mesh=isosrf)

# ----
dm3_5 = DMesh3(implinters)
dm3_6 = DMesh3(iterholefill)
dm3_7 = DMesh3(rmsh)
mesh = Mesh(repairmsh)
dm3_8 = DMesh3(dm3_5)  # disabled

# ---- group: Smooth
laplacesmooth = SmoothMesh(Mesh=dm3_8, InteriorWeight=Slider(0.3, range=0..1))

# ----
compact = CompactMesh()
deconmsh = DeconstructMesh(Mesh=compact)  # -> VertexIndices, Vertices, FaceIndices, Faces, Colours

dm3_9 = DMesh3(laplacesmooth)

# ---- group: Reduce Mesh
dm3_10 = DMesh3(dm3)  # disabled

deconmsh_2 = DeconstructMesh(Mesh=dm3_10)  # -> VertexIndices, Vertices, FaceIndices, Faces, Colours
lng = ListLength(List=deconmsh_2.Faces)
multiplication_2 = Multiplication(A=lng, B="0.01")

reduce = ReduceMesh(Mesh=dm3_10, NumberOfFaces=multiplication_2, ConstrainEdges=toggle_2, ProjectToInput=toggle)

# ----
dm3_11 = DMesh3(reduce)
dm3_12 = DMesh3(dm3_11)  # disabled
dm3_13 = DMesh3(dm3_11)  # disabled

# ---- group: Voxel + Boxmap
voxl = Voxelize(Mesh=dm3_13, NumberOfCells=64)
bbox_2 = BoundingBox(Content=voxl, Plane=PlaneXY(0, 0, 0))  # -> Box, Box_2
bbox_3 = BoundingBox(Content=dm3_13, Plane=PlaneXY(0, 0, 0))  # -> Box, Box_2
mesh_2 = Mesh(voxl)
boxmap = BoxMapping(Geometry=mesh_2, Source=bbox_2.Box, Target=bbox_3.Box)  # -> Geometry, Transform

# ----
deconmsh_3 = DeconstructMesh(Mesh=dm3_12)  # -> VertexIndices, Vertices, FaceIndices, Faces, Colours
deconmsh_4 = DeconstructMesh()  # -> VertexIndices, Vertices, FaceIndices, Faces, Colours

panel = Panel(deconmsh.FaceIndices)
panel_2 = Panel(deconmsh_4.FaceIndices)

pt_2 = Point(deconmsh_3.Vertices)
pt_3 = Point(deconmsh_4.Vertices)

mesh_3 = Mesh(boxmap.Geometry)

# ---- group: Fill a mesh hole
dm3_14 = DMesh3(dm3)  # disabled

edgeloops = MeshBoundaryEdgeLoops(DMesh3=dm3_14)
edge_loop = EdgeLoop(edgeloops)
item = ListItem(List=edge_loop, Index=0, Wrap=True)

holefill = MeshHoleFill(Mesh=dm3_14, EdgeLoop=item, EdgeLength=1, Type=1)

# ----
dm3_15 = DMesh3(holefill)
